# Grasshopper definition mesh-maker.gh (Grasshopper 1.0.7)

list = ValueList({"Gentle Waves": "gentle-waves", "Organic Terrain": "organic-terrain", "Sharp Ridges": "sharp-ridges", "Voronoi Cells": "voronoi-cells", "Subtle Texture": "subtle-texture", "Deep Carve": "deep-carve", "Sculptural": "sculptural", "Hard Wave": "hard-wave", "Eroded Stone": "eroded-stone", "Billowy Clouds": "billowy-clouds", "Turbulent Marble": "turbulent-marble", "Natural Ridge": "natural-ridge", "Organic Swirl": "organic-swirl", "Worley Cracks": "worley-cracks", "Brushed Metal": "brushed-metal"}, selected="Organic Terrain")
frequency = Slider(0.22, range=0.01..0.5)
amplitude = Slider(0.75, range=0.01..6)
mesh_x = Slider(36, range=1..36)
mesh_y = Slider(24, range=1..24)
resolution = Slider(128, range=16..1024)
list_2 = ValueList({"Simplex": "simplex", "Perlin": "perlin", "Value": "value", "OpenSimplex2": "opensimplex2", "Ridged": "ridged", "Billow": "billow", "FBM": "fbm", "Turbulence": "turbulence", "Hybrid Multifractal": "hybrid", "Hetero Terrain": "hetero", "Domain Warp": "domainwarp", "Voronoi": "voronoi", "Worley": "worley", "Gabor": "gabor", "Wavelet": "wavelet"}, selected="Simplex")
noise_exp = Slider(1.07, range=0.1..3)
seed = Slider(81105, range=0..99999)
offset = Slider(-1.5, range=-2..2)
gabor_angle = Slider(45, range=0..180)
gabor_bw = Slider(1.5, range=0.1..3)
valley_floor = Slider(0.2, range=0..1)
valley_exp = Slider(0.1, range=0.1..3)
octaves = Slider(3, range=1..8)
distortion = Slider(1, range=0..1)
peak_exp = Slider(0.35, range=0.1..3)
persistence = Slider(0.1, range=0.1..0.9)
lacunarity = Slider(1, range=1..4)
contrast = Slider(1.05, range=0.1..3)
sharpness = Slider(1.8, range=0..2)
smooth_iter = Slider(10, range=0..20)
smooth_str = Slider(0.4, range=0..1)
resolution_2 = Slider(370, range=16..1024)
seed_2 = Slider(81105, range=0..99999)
gabor_angle_2 = Slider(120.7, range=0..180)
gabor_bw_2 = Slider(1.5, range=0.1..3)
meshcraft_presets = MeshCraftPresets(preset=list)  # -> noise_type, frequency, amplitude, noise_exp, peak_exp, valley_exp, valley_floor, offset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
# ---------- meshcraft_presets: Python ----------
# GHPython component script — MeshCraft | Presets
# Runtime: IronPython 2.7 (Rhino 7)
#
# Inputs:  preset (str) — name of preset to load
# Outputs: noise_type, frequency, amplitude, noise_exp, peak_exp, valley_exp,
#          valley_floor, offset, octaves, persistence, lacunarity, distortion,
#          contrast, sharpness, mesh_x, mesh_y, smooth_iter, smooth_str
#
# Usage: wire any output to the matching input on Noise/Shape/Smooth components
#        to override the slider value for that parameter.

PRESETS = {
    'gentle-waves':    {'noise_type':'simplex',    'frequency':0.06, 'amplitude':0.50, 'noise_exp':0.5, 'peak_exp':1.0, 'valley_exp':1.0,  'valley_floor':0.00, 'offset': 0.0, 'octaves':2, 'persistence':0.30, 'lacunarity':2.0, 'distortion':0.00, 'contrast':1.0, 'sharpness':0.00, 'mesh_x':36, 'mesh_y':24, 'smooth_iter':3, 'smooth_str':0.5},
    'organic-terrain': {'noise_type':'fbm',        'frequency':0.10, 'amplitude':0.80, 'noise_exp':0.7, 'peak_exp':1.0, 'valley_exp':1.0,  'valley_floor':0.00, 'offset': 0.0, 'octaves':4, 'persistence':0.55, 'lacunarity':2.0, 'distortion':0.30, 'contrast':1.2, 'sharpness':0.20, 'mesh_x':36, 'mesh_y':24, 'smooth_iter':1, 'smooth_str':0.4},
    'sharp-ridges':    {'noise_type':'ridged',     'frequency':0.08, 'amplitude':0.50, 'noise_exp':1.5, 'peak_exp':1.0, 'valley_exp':1.0,  'valley_floor':0.00, 'offset': 0.3, 'octaves':3, 'persistence':0.50, 'lacunarity':2.2, 'distortion':0.00, 'contrast':1.5, 'sharpness':0.80, 'mesh_x':36, 'mesh_y':24, 'smooth_iter':0, 'smooth_str':0.0},
    'voronoi-cells':   {'noise_type':'voronoi',    'frequency':0.15, 'amplitude':0.30, 'noise_exp':0.8, 'peak_exp':1.0, 'valley_exp':1.0,  'valley_floor':0.00, 'offset': 0.3, 'octaves':1, 'persistence':0.50, 'lacunarity':2.0, 'distortion':0.00, 'contrast':1.0, 'sharpness':0.00, 'mesh_x':36, 'mesh_y':24, 'smooth_iter':2, 'smooth_str':0.6},
    'subtle-texture':  {'noise_type':'perlin',     'frequency':0.12, 'amplitude':0.25, 'noise_exp':0.5, 'peak_exp':1.0, 'valley_exp':1.0,  'valley_floor':0.00, 'offset': 0.0, 'octaves':3, 'persistence':0.40, 'lacunarity':2.5, 'distortion':0.10, 'contrast':0.8, 'sharpness':0.00, 'mesh_x':36, 'mesh_y':24, 'smooth_iter':2, 'smooth_str':0.7},
    'deep-carve':      {'noise_type':'fbm',        'frequency':0.05, 'amplitude':2.00, 'noise_exp':1.2, 'peak_exp':1.0, 'valley_exp':1.0,  'valley_floor':0.00, 'offset':-0.3, 'octaves':5, 'persistence':0.60, 'lacunarity':1.8, 'distortion':0.40, 'contrast':1.8, 'sharpness':0.50, 'mesh_x':24, 'mesh_y':18, 'smooth_iter':0, 'smooth_str':0.0},
    'sculptural':      {'noise_type':'fbm',        'frequency':0.04, 'amplitude':1.50, 'noise_exp':0.7, 'peak_exp':1.8, 'valley_exp':0.35, 'valley_floor':0.60, 'offset': 0.0, 'octaves':3, 'persistence':0.55, 'lacunarity':1.8, 'distortion':0.40, 'contrast':1.3, 'sharpness':0.15, 'mesh_x':36, 'mesh_y':24, 'smooth_iter':2, 'smooth_str':0.45},
    'hard-wave':       {'noise_type':'simplex',    'frequency':0.05, 'amplitude':1.20, 'noise_exp':0.6, 'peak_exp':2.0, 'valley_exp':0.30, 'valley_floor':0.75, 'offset': 0.1, 'octaves':2, 'persistence':0.40, 'lacunarity':2.0, 'distortion':0.25, 'contrast':1.4, 'sharpness':0.10, 'mesh_x':36, 'mesh_y':24, 'smooth_iter':3, 'smooth_str':0.5},
    'eroded-stone':    {'noise_type':'ridged',     'frequency':0.06, 'amplitude':0.50, 'noise_exp':0.8, 'peak_exp':1.5, 'valley_exp':0.40, 'valley_floor':0.50, 'offset': 0.4, 'octaves':4, 'persistence':0.50, 'lacunarity':2.2, 'distortion':0.35, 'contrast':1.6, 'sharpness':0.30, 'mesh_x':36, 'mesh_y':24, 'smooth_iter':1, 'smooth_str':0.3},
    'billowy-clouds':  {'noise_type':'billow',     'frequency':0.07, 'amplitude':0.80, 'noise_exp':0.5, 'peak_exp':1.0, 'valley_exp':1.0,  'valley_floor':0.00, 'offset': 0.0, 'octaves':3, 'persistence':0.45, 'lacunarity':2.0, 'distortion':0.15, 'contrast':1.0, 'sharpness':0.00, 'mesh_x':36, 'mesh_y':24, 'smooth_iter':2, 'smooth_str':0.5},
    'turbulent-marble':{'noise_type':'turbulence', 'frequency':0.08, 'amplitude':1.00, 'noise_exp':0.7, 'peak_exp':1.0, 'valley_exp':1.0,  'valley_floor':0.00, 'offset': 0.0, 'octaves':5, 'persistence':0.55, 'lacunarity':2.2, 'distortion':0.30, 'contrast':1.4, 'sharpness':0.30, 'mesh_x':36, 'mesh_y':24, 'smooth_iter':1, 'smooth_str':0.3},
    'natural-ridge':   {'noise_type':'hybrid',     'frequency':0.06, 'amplitude':1.20, 'noise_exp':0.6, 'peak_exp':1.2, 'valley_exp':0.50, 'valley_floor':0.30, 'offset': 0.0, 'octaves':4, 'persistence':0.50, 'lacunarity':2.0, 'distortion':0.20, 'contrast':1.2, 'sharpness':0.10, 'mesh_x':36, 'mesh_y':24, 'smooth_iter':1, 'smooth_str':0.4},
    'organic-swirl':   {'noise_type':'domainwarp', 'frequency':0.05, 'amplitude':1.00, 'noise_exp':0.5, 'peak_exp':1.0, 'valley_exp':1.0,  'valley_floor':0.00, 'offset': 0.0, 'octaves':3, 'persistence':0.50, 'lacunarity':1.8, 'distortion':0.00, 'contrast':1.1, 'sharpness':0.00, 'mesh_x':36, 'mesh_y':24, 'smooth_iter':2, 'smooth_str':0.5},
    'worley-cracks':   {'noise_type':'worley',     'frequency':0.12, 'amplitude':0.50, 'noise_exp':0.8, 'peak_exp':1.0, 'valley_exp':1.0,  'valley_floor':0.00, 'offset': 0.2, 'octaves':1, 'persistence':0.50, 'lacunarity':2.0, 'distortion':0.10, 'contrast':1.2, 'sharpness':0.30, 'mesh_x':36, 'mesh_y':24, 'smooth_iter':1, 'smooth_str':0.4},
    'brushed-metal':   {'noise_type':'gabor',      'frequency':0.10, 'amplitude':0.30, 'noise_exp':0.5, 'peak_exp':1.0, 'valley_exp':1.0,  'valley_floor':0.00, 'offset': 0.0, 'octaves':1, 'persistence':0.50, 'lacunarity':2.0, 'distortion':0.00, 'contrast':1.0, 'sharpness':0.00, 'mesh_x':36, 'mesh_y':24, 'smooth_iter':1, 'smooth_str':0.3},
}

p = PRESETS.get(str(preset), PRESETS['gentle-waves'])

noise_type   = p['noise_type']
frequency    = p['frequency']
amplitude    = p['amplitude']
noise_exp    = p['noise_exp']
peak_exp     = p['peak_exp']
valley_exp   = p['valley_exp']
valley_floor = p['valley_floor']
offset       = p['offset']
octaves      = p['octaves']
persistence  = p['persistence']
lacunarity   = p['lacunarity']
distortion   = p['distortion']
contrast     = p['contrast']
sharpness    = p['sharpness']
mesh_x       = p['mesh_x']
mesh_y       = p['mesh_y']
smooth_iter  = p['smooth_iter']
smooth_str   = p['smooth_str']
# ---------- end meshcraft_presets ----------
meshcraft_noise_dll_loader = GhPythonScript(
    noise_type=list_2,
    seed=seed,
    frequency=frequency,
    octaves=octaves,
    persistence=persistence,
    lacunarity=lacunarity,
    distortion=distortion,
    gabor_angle=gabor_angle,
    gabor_bw=gabor_bw,
    mesh_x=mesh_x,
    mesh_y=mesh_y,
    resolution=resolution)  # -> z_values, cols, rows, mesh_x, mesh_y; inputs seed: Int32, octaves: Int32, resolution: Int32
# ---------- meshcraft_noise_dll_loader: Python ----------
#! python 2
# MeshCraft | Noise (DLL loader)
# Loads compiled C# DLL for noise generation, outputs z_values as DataTree[float]
import clr, os, System
import Grasshopper as gh
from Grasshopper import DataTree
from Grasshopper.Kernel.Data import GH_Path
from System.Collections.Generic import List as NetList

_msg = ghenv.Component.AddRuntimeMessage
_warn = gh.Kernel.GH_RuntimeMessageLevel.Warning
_err  = gh.Kernel.GH_RuntimeMessageLevel.Error

# ── Load DLL ──
_dll_name = "MeshCraftNoise"
_loaded = False

try:
    clr.AddReference(_dll_name)
    _loaded = True
except:
    pass

if not _loaded:
    try:
        _gh_dir = os.path.dirname(ghdoc.Path) if ghdoc.Path else ""
        if _gh_dir:
            dll_path = os.path.join(_gh_dir, _dll_name + ".dll")
            if os.path.exists(dll_path):
                clr.AddReferenceToFileAndPath(dll_path)
                _loaded = True
    except:
        pass

if not _loaded:
    _msg(_err, "Cannot find MeshCraftNoise.dll")
else:
    from MeshCraftNoise import Generate

    # ── Safe defaults ──
    def _d(name, default):
        val = globals().get(name, None)
        return default if val is None else val

    nt   = str(_d('noise_type', 'simplex'))
    sd   = int(_d('seed', 0))
    freq = float(_d('frequency', 0.1))
    octs = int(_d('octaves', 2))
    pers = float(_d('persistence', 0.5))
    lac  = float(_d('lacunarity', 2.0))
    dist = float(_d('distortion', 0.0))
    ga   = float(_d('gabor_angle', 45.0))
    gb   = float(_d('gabor_bw', 1.5))
    mx   = float(_d('mesh_x', 36.0))
    my   = float(_d('mesh_y', 24.0))
    res  = int(_d('resolution', 96))

    _cols = res
    _rows = max(4, int(round(res * (my / mx))))

    # ── Generate noise ──
    result = Generate(nt, sd, freq, octs, pers, lac, dist, ga, gb, mx, my, res)
    z_arr = result[0]  # Array[float]

    # ── Output as DataTree[float] ──
    # GhPython silently drops Python lists and .NET arrays for large collections.
    # DataTree[float] is the only reliable output format for 200K+ items.
    z_tree = DataTree[float]()
    z_tree.AddRange(NetList[float](z_arr), GH_Path(0))

    z_values = z_tree
    cols = _cols
    rows = _rows
    mesh_x = mx
    mesh_y = my
# ---------- end meshcraft_noise_dll_loader ----------
meshcraft_noise_dll_loader_2 = GhPythonScript(
    noise_type=meshcraft_presets.noise_type,
    seed=seed_2,
    frequency=meshcraft_presets.frequency,
    octaves=meshcraft_presets.octaves,
    persistence=meshcraft_presets.persistence,
    lacunarity=meshcraft_presets.lacunarity,
    distortion=meshcraft_presets.distortion,
    gabor_angle=gabor_angle_2,
    gabor_bw=gabor_bw_2,
    mesh_x=meshcraft_presets.mesh_x,
    mesh_y=meshcraft_presets.mesh_y,
    resolution=resolution_2)  # -> z_values, cols, rows, mesh_x, mesh_y; inputs seed: Int32, octaves: Int32, resolution: Int32; same code as meshcraft_noise_dll_loader
meshcraft_shape = MeshCraftShape(
    z_values=meshcraft_noise_dll_loader_2.z_values,
    cols=meshcraft_noise_dll_loader_2.cols,
    rows=meshcraft_noise_dll_loader_2.rows,
    mesh_x=meshcraft_noise_dll_loader_2.mesh_x,
    mesh_y=meshcraft_noise_dll_loader_2.mesh_y,
    amplitude=meshcraft_presets.amplitude,
    noise_exp=meshcraft_presets.noise_exp,
    peak_exp=meshcraft_presets.peak_exp,
    valley_exp=meshcraft_presets.valley_exp,
    valley_floor=meshcraft_presets.valley_floor,
    offset=meshcraft_presets.offset,
    contrast=meshcraft_presets.contrast,
    sharpness=meshcraft_presets.sharpness)  # -> pts, cols, rows; inputs z_values: list, cols: Int32, rows: Int32
# ---------- meshcraft_shape: Python ----------
#! python 2
# MeshCraft | Shape (DLL loader)
# Calls compiled C# Shape() for the heavy math, outputs pts as DataTree[Point3d]
import clr, System
import Rhino.Geometry as rg
import Grasshopper as gh
from Grasshopper import DataTree
from Grasshopper.Kernel.Data import GH_Path
from System.Collections.Generic import List as NetList

_msg = ghenv.Component.AddRuntimeMessage
_err = gh.Kernel.GH_RuntimeMessageLevel.Error

# ── Load DLL (same as node 1) ──
try:
    clr.AddReference("MeshCraftNoise")
except:
    import os
    _gh_dir = os.path.dirname(ghdoc.Path) if ghdoc.Path else ""
    if _gh_dir:
        clr.AddReferenceToFileAndPath(os.path.join(_gh_dir, "MeshCraftNoise.dll"))

from MeshCraftNoise import Shape

# ── Safe defaults ──
def _d(name, default):
    val = globals().get(name, None)
    return default if val is None else val

amplitude    = float(_d('amplitude', 0.65))
noise_exp    = float(_d('noise_exp', 0.5))
peak_exp     = float(_d('peak_exp', 1.0))
valley_exp   = float(_d('valley_exp', 1.0))
valley_floor = float(_d('valley_floor', 0.0))
offset       = float(_d('offset', 0.0))
contrast     = float(_d('contrast', 1.0))
sharpness    = float(_d('sharpness', 0.0))
cols_i = int(float(_d('cols', 96)))
rows_i = int(float(_d('rows', 64)))
mx = float(_d('mesh_x', 36.0))
my = float(_d('mesh_y', 24.0))

total = cols_i * rows_i

# ── Extract z_values from GH_Number wrappers into .NET double array ──
zv_in = globals().get('z_values', None)
if zv_in is None or len(zv_in) == 0:
    _msg(_err, "FATAL: z_values is None or empty.")
    pts = DataTree[rg.Point3d]()
    cols = cols_i
    rows = rows_i
else:
    z_arr = System.Array.CreateInstance(float, total)
    for k in xrange(total):
        z_arr[k] = float(zv_in[k])

    # ── Call compiled Shape() -- returns flat xyz array ──
    xyz = Shape(z_arr, cols_i, rows_i, mx, my,
                amplitude, noise_exp, peak_exp, valley_exp,
                valley_floor, offset, contrast, sharpness)

    # ── Build Point3d DataTree for output ──
    pt_list = NetList[rg.Point3d]()
    for k in xrange(total):
        idx = k * 3
        pt_list.Add(rg.Point3d(xyz[idx], xyz[idx + 1], xyz[idx + 2]))

    pt_tree = DataTree[rg.Point3d]()
    pt_tree.AddRange(pt_list, GH_Path(0))

    pts = pt_tree
    cols = cols_i
    rows = rows_i
# ---------- end meshcraft_shape ----------
meshcraft_shape_2 = MeshCraftShape(
    z_values=meshcraft_noise_dll_loader.z_values,
    cols=meshcraft_noise_dll_loader.cols,
    rows=meshcraft_noise_dll_loader.rows,
    mesh_x=meshcraft_noise_dll_loader.mesh_x,
    mesh_y=meshcraft_noise_dll_loader.mesh_y,
    amplitude=amplitude,
    noise_exp=noise_exp,
    peak_exp=peak_exp,
    valley_exp=valley_exp,
    valley_floor=valley_floor,
    offset=offset,
    contrast=contrast,
    sharpness=sharpness)  # -> pts, cols, rows; inputs z_values: list, cols: Int32, rows: Int32; same code as meshcraft_shape
meshcraft_smooth = CSharpScript(
    pts=meshcraft_shape_2.pts,
    cols=meshcraft_shape_2.cols,
    rows=meshcraft_shape_2.rows,
    smooth_iter=smooth_iter,
    smooth_str=smooth_str)  # -> A; inputs pts: list of Point3d, cols: Int32, rows: Int32, smooth_iter: Int32, smooth_str: Double
# ---------- meshcraft_smooth: C# ----------
if (pts == null || pts.Count == 0 || smooth_iter <= 0 || smooth_str <= 0.0)
{
  A = pts;
  return;
}

int total = cols * rows;
if (pts.Count < total) { A = pts; return; }

double[] xs = new double[total];
double[] ys = new double[total];
double[] zv = new double[total];

for (int k = 0; k < total; k++)
{
  Point3d p = pts[k];
  xs[k] = p.X;
  ys[k] = p.Y;
  zv[k] = p.Z;
}

double invStr = 1.0 - smooth_str;

for (int iter = 0; iter < smooth_iter; iter++)
{
  double[] nzv = new double[total];

  for (int j = 0; j < rows; j++)
  {
    bool jAbove = j > 0;
    bool jBelow = j < rows - 1;
    int rowOff = j * cols;

    for (int i = 0; i < cols; i++)
    {
      bool iLeft = i > 0;
      bool iRight = i < cols - 1;
      int idx = rowOff + i;

      double ws = zv[idx] * 4.0;
      double tw = 4.0;

      if (jAbove) { ws += zv[idx - cols] * 2.0; tw += 2.0; }
      if (jBelow) { ws += zv[idx + cols] * 2.0; tw += 2.0; }
      if (iLeft)  { ws += zv[idx - 1] * 2.0;    tw += 2.0; }
      if (iRight) { ws += zv[idx + 1] * 2.0;    tw += 2.0; }

      if (jAbove && iLeft)  { ws += zv[idx - cols - 1]; tw += 1.0; }
      if (jAbove && iRight) { ws += zv[idx - cols + 1]; tw += 1.0; }
      if (jBelow && iLeft)  { ws += zv[idx + cols - 1]; tw += 1.0; }
      if (jBelow && iRight) { ws += zv[idx + cols + 1]; tw += 1.0; }

      nzv[idx] = zv[idx] * invStr + (ws / tw) * smooth_str;
    }
  }

  zv = nzv;
}

List<Point3d> result = new List<Point3d>(total);
for (int k = 0; k < total; k++)
{
  result.Add(new Point3d(xs[k], ys[k], zv[k]));
}

A = result;
# ---------- end meshcraft_smooth ----------
meshcraft_smooth_2 = CSharpScript(
    pts=meshcraft_shape.pts,
    cols=meshcraft_shape.cols,
    rows=meshcraft_shape.rows,
    smooth_iter=meshcraft_presets.smooth_iter,
    smooth_str=meshcraft_presets.smooth_str)  # -> A; inputs pts: list of Point3d, cols: Int32, rows: Int32, smooth_iter: Int32, smooth_str: Double; same code as meshcraft_smooth
meshcraft_point_mesh_surface = GhPythonScript(A=meshcraft_smooth_2, cols=meshcraft_shape.cols, rows=meshcraft_shape.rows)  # -> a; inputs A: list of Point3d, cols: Int32, rows: Int32
# ---------- meshcraft_point_mesh_surface: Python ----------
#! python 2
# MeshCraft | Point Mesh Surface (DLL-assisted)
# Uses compiled BuildFaces() for face index math, builds Mesh in Python
# Input: A (list of Point3d, List Access), cols (int), rows (int)
# Output: a (Mesh)
import clr, System
import Rhino.Geometry as rg
import Grasshopper as gh

_msg = ghenv.Component.AddRuntimeMessage
_err = gh.Kernel.GH_RuntimeMessageLevel.Error

# ── Load DLL ──
try:
    clr.AddReference("MeshCraftNoise")
except:
    import os
    _gh_dir = os.path.dirname(ghdoc.Path) if ghdoc.Path else ""
    if _gh_dir:
        clr.AddReferenceToFileAndPath(os.path.join(_gh_dir, "MeshCraftNoise.dll"))

from MeshCraftNoise import BuildFaces

def _d(name, default):
    val = globals().get(name, None)
    return default if val is None else val

cols_i = int(float(_d('cols', 96)))
rows_i = int(float(_d('rows', 64)))

mesh = rg.Mesh()

if A is not None and len(A) > 0:
    verts = mesh.Vertices
    for p in A:
        if p is None:
            verts.Add(0.0, 0.0, 0.0)
        elif isinstance(p, rg.Point3d):
            verts.Add(p.X, p.Y, p.Z)
        else:
            verts.Add(float(p.X), float(p.Y), float(p.Z))

    # ── Get face indices from compiled C# ──
    face_idx = BuildFaces(cols_i, rows_i)

    faces = mesh.Faces
    fc = len(face_idx) / 4
    for f in xrange(fc):
        fi = f * 4
        faces.AddFace(face_idx[fi], face_idx[fi + 1], face_idx[fi + 2], face_idx[fi + 3])

    mesh.Normals.ComputeNormals()
    mesh.FaceNormals.ComputeFaceNormals()
    mesh.Compact()

a = mesh
# ---------- end meshcraft_point_mesh_surface ----------
meshcraft_point_mesh_surface_2 = GhPythonScript(A=meshcraft_smooth, cols=meshcraft_shape_2.cols, rows=meshcraft_shape_2.rows, watertight=Toggle(True))  # -> a; inputs A: list of Point3d, cols: Int32, rows: Int32, watertight: Boolean; same code as meshcraft_point_mesh_surface
panel = Panel(meshcraft_point_mesh_surface)
panel_2 = Panel(meshcraft_point_mesh_surface_2)
